# Dynamo graph fem2geo.dyn (Dynamo 2.13.1.3887)
# packages: spring nodes 210.1.1

code_block = CodeBlock { t1 = ".\\xi_bei_kou.xlsx"; }
file_from_path = FileObject(path=code_block)
code_block_2 = CodeBlock(t12=file_from_path)
# ---------- code_block_2.designscript (13 lines) ----------
t4 = t12;
t1 = t4;
t2 = DSOffice.Data.ImportExcel(t1, "Sheet1", false, true);
t3 = DSOffice.Data.ImportExcel(t1, "Sheet2", false, true);
t5 = List.Transpose(t3);
t6 = List.Transpose(t2);
t7 = List.GetItemAtIndex(t6, 1);
t8 = List.GetItemAtIndex(t6, 2);
t9 = List.GetItemAtIndex(t6, 3);
t11 = [0, 9];
t13 = List.RemoveItemAtIndex(t5, t11);
a = t13;
t10 = a - 1;
# ----------------------------------------
byCoordinates = Point.ByCoordinates(x=code_block_2.t7, y=code_block_2.t8, z=code_block_2.t9)
transpose = List.Transpose(lists=code_block_2.t10)
code_block_3 = CodeBlock { 18651; }
takeItems = List.TakeItems(list=transpose, amount=code_block_3)
transpose_2 = List.Transpose(lists=takeItems)
code_block_4 = CodeBlock { 0..3; }
getItemAtIndex = List.GetItemAtIndex(list=transpose_2, index=code_block_4)
transpose_3 = List.Transpose(lists=getItemAtIndex)
getItemAtIndex_2 = List.GetItemAtIndex(list=byCoordinates, index=transpose_3)
boolean = BoolSelector(true)
byPoints = PolyCurve.ByPoints(points=getItemAtIndex_2, connectLastToFirst=boolean)
code_block_5 = CodeBlock { 8088; 8089; 11659; 13338; }
getItemAtIndex_3 = List.GetItemAtIndex(list=byPoints, index=code_block_5.out0)
reverse = Curve.Reverse(curve=getItemAtIndex_3)
code_block_6 = CodeBlock { 4..7; }
getItemAtIndex_4 = List.GetItemAtIndex(list=transpose_2, index=code_block_6)
transpose_4 = List.Transpose(lists=getItemAtIndex_4)
getItemAtIndex_5 = List.GetItemAtIndex(list=byCoordinates, index=transpose_4)
boolean_2 = BoolSelector(true)
byPoints_2 = PolyCurve.ByPoints(points=getItemAtIndex_5, connectLastToFirst=boolean_2)
code_block_7 = CodeBlock { 8088; 8089; 11659; 13338; }
getItemAtIndex_6 = List.GetItemAtIndex(list=byPoints_2, index=code_block_7.out0)
list_create = List.Create(item0=reverse, item1=getItemAtIndex_6)
file_path = Filename("G:\test.sat")
code_block_8 = CodeBlock { [8088,8089,11659,13338]; }
removeItemAtIndex = List.RemoveItemAtIndex(list=byPoints, indices=code_block_8)
code_block_9 = CodeBlock { [8088,8089,11659,13338]; }
removeItemAtIndex_2 = List.RemoveItemAtIndex(list=byPoints_2, indices=code_block_9)
list_create_2 = List.Create(item0=removeItemAtIndex, item1=removeItemAtIndex_2)
transpose_5 = List.Transpose(lists=list_create_2)
byLoft = Solid.ByLoft(crossSections=transpose_5)
dropItems = List.DropItems(list=transpose, amount=code_block_3)
transpose_6 = List.Transpose(lists=dropItems)
code_block_10 = CodeBlock { 0..3; }
getItemAtIndex_7 = List.GetItemAtIndex(list=transpose_6, index=code_block_10)
transpose_7 = List.Transpose(lists=getItemAtIndex_7)
getItemAtIndex_8 = List.GetItemAtIndex(list=byCoordinates, index=transpose_7)
boolean_3 = BoolSelector(false)
byPoints_3 = PolyCurve.ByPoints(points=getItemAtIndex_8, connectLastToFirst=boolean_3)
code_block_11 = CodeBlock { 4..7; }
getItemAtIndex_9 = List.GetItemAtIndex(list=transpose_6, index=code_block_11)
transpose_8 = List.Transpose(lists=getItemAtIndex_9)
getItemAtIndex_10 = List.GetItemAtIndex(list=byCoordinates, index=transpose_8)
boolean_4 = BoolSelector(false)
byPoints_4 = PolyCurve.ByPoints(points=getItemAtIndex_10, connectLastToFirst=boolean_4)
list_create_3 = List.Create(item0=byPoints_3, item1=byPoints_4)
transpose_9 = List.Transpose(lists=list_create_3)
byLoft_2 = Solid.ByLoft(crossSections=transpose_9)
curves = PolyCurve.Curves(polyCurve=getItemAtIndex_3)
code_block_12 = CodeBlock { 2; }
takeItems_2 = List.TakeItems(list=curves, amount=code_block_12)
byJoinedCurves = PolyCurve.ByJoinedCurves(curves=takeItems_2)
closeWithLine = PolyCurve.CloseWithLine(polyCurve=byJoinedCurves)
curves_2 = PolyCurve.Curves(polyCurve=getItemAtIndex_6)
takeItems_3 = List.TakeItems(list=curves_2, amount=code_block_12)
byJoinedCurves_2 = PolyCurve.ByJoinedCurves(curves=takeItems_3)
closeWithLine_2 = PolyCurve.CloseWithLine(polyCurve=byJoinedCurves_2)
list_create_4 = List.Create(item0=closeWithLine, item1=closeWithLine_2)
byLoft_3 = Solid.ByLoft(crossSections=list_create_4)
dropItems_2 = List.DropItems(list=curves, amount=code_block_12)
byJoinedCurves_3 = PolyCurve.ByJoinedCurves(curves=dropItems_2)
closeWithLine_3 = PolyCurve.CloseWithLine(polyCurve=byJoinedCurves_3)
dropItems_3 = List.DropItems(list=curves_2, amount=code_block_12)
byJoinedCurves_4 = PolyCurve.ByJoinedCurves(curves=dropItems_3)
closeWithLine_4 = PolyCurve.CloseWithLine(polyCurve=byJoinedCurves_4)
list_create_5 = List.Create(item0=closeWithLine_3, item1=closeWithLine_4)
byLoft_4 = Solid.ByLoft(crossSections=list_create_5)
getItemAtIndex_11 = List.GetItemAtIndex(list=byPoints, index=code_block_5.out1)
curves_3 = PolyCurve.Curves(polyCurve=getItemAtIndex_11)
takeItems_4 = List.TakeItems(list=curves_3, amount=code_block_12)
byJoinedCurves_5 = PolyCurve.ByJoinedCurves(curves=takeItems_4)
closeWithLine_5 = PolyCurve.CloseWithLine(polyCurve=byJoinedCurves_5)
getItemAtIndex_12 = List.GetItemAtIndex(list=byPoints_2, index=code_block_7.out1)
curves_4 = PolyCurve.Curves(polyCurve=getItemAtIndex_12)
takeItems_5 = List.TakeItems(list=curves_4, amount=code_block_12)
byJoinedCurves_6 = PolyCurve.ByJoinedCurves(curves=takeItems_5)
closeWithLine_6 = PolyCurve.CloseWithLine(polyCurve=byJoinedCurves_6)
list_create_6 = List.Create(item0=closeWithLine_5, item1=closeWithLine_6)
byLoft_5 = Solid.ByLoft(crossSections=list_create_6)
dropItems_4 = List.DropItems(list=curves_3, amount=code_block_12)
byJoinedCurves_7 = PolyCurve.ByJoinedCurves(curves=dropItems_4)
closeWithLine_7 = PolyCurve.CloseWithLine(polyCurve=byJoinedCurves_7)
dropItems_5 = List.DropItems(list=curves_4, amount=code_block_12)
byJoinedCurves_8 = PolyCurve.ByJoinedCurves(curves=dropItems_5)
closeWithLine_8 = PolyCurve.CloseWithLine(polyCurve=byJoinedCurves_8)
list_create_7 = List.Create(item0=closeWithLine_7, item1=closeWithLine_8)
byLoft_6 = Solid.ByLoft(crossSections=list_create_7)
getItemAtIndex_13 = List.GetItemAtIndex(list=byPoints, index=code_block_5.out2)
curves_5 = PolyCurve.Curves(polyCurve=getItemAtIndex_13)
takeItems_6 = List.TakeItems(list=curves_5, amount=code_block_12)
byJoinedCurves_9 = PolyCurve.ByJoinedCurves(curves=takeItems_6)
closeWithLine_9 = PolyCurve.CloseWithLine(polyCurve=byJoinedCurves_9)
getItemAtIndex_14 = List.GetItemAtIndex(list=byPoints_2, index=code_block_7.out2)
curves_6 = PolyCurve.Curves(polyCurve=getItemAtIndex_14)
takeItems_7 = List.TakeItems(list=curves_6, amount=code_block_12)
byJoinedCurves_10 = PolyCurve.ByJoinedCurves(curves=takeItems_7)
closeWithLine_10 = PolyCurve.CloseWithLine(polyCurve=byJoinedCurves_10)
list_create_8 = List.Create(item0=closeWithLine_9, item1=closeWithLine_10)
byLoft_7 = Solid.ByLoft(crossSections=list_create_8)
dropItems_6 = List.DropItems(list=curves_5, amount=code_block_12)
byJoinedCurves_11 = PolyCurve.ByJoinedCurves(curves=dropItems_6)
closeWithLine_11 = PolyCurve.CloseWithLine(polyCurve=byJoinedCurves_11)
dropItems_7 = List.DropItems(list=curves_6, amount=code_block_12)
byJoinedCurves_12 = PolyCurve.ByJoinedCurves(curves=dropItems_7)
closeWithLine_12 = PolyCurve.CloseWithLine(polyCurve=byJoinedCurves_12)
list_create_9 = List.Create(item0=closeWithLine_11, item1=closeWithLine_12)
byLoft_8 = Solid.ByLoft(crossSections=list_create_9)
getItemAtIndex_15 = List.GetItemAtIndex(list=byPoints, index=code_block_5.out3)
curves_7 = PolyCurve.Curves(polyCurve=getItemAtIndex_15)
takeItems_8 = List.TakeItems(list=curves_7, amount=code_block_12)
byJoinedCurves_13 = PolyCurve.ByJoinedCurves(curves=takeItems_8)
closeWithLine_13 = PolyCurve.CloseWithLine(polyCurve=byJoinedCurves_13)
getItemAtIndex_16 = List.GetItemAtIndex(list=byPoints_2, index=code_block_7.out3)
curves_8 = PolyCurve.Curves(polyCurve=getItemAtIndex_16)
takeItems_9 = List.TakeItems(list=curves_8, amount=code_block_12)
byJoinedCurves_14 = PolyCurve.ByJoinedCurves(curves=takeItems_9)
closeWithLine_14 = PolyCurve.CloseWithLine(polyCurve=byJoinedCurves_14)
list_create_10 = List.Create(item0=closeWithLine_13, item1=closeWithLine_14)
byLoft_9 = Solid.ByLoft(crossSections=list_create_10)
dropItems_8 = List.DropItems(list=curves_7, amount=code_block_12)
byJoinedCurves_15 = PolyCurve.ByJoinedCurves(curves=dropItems_8)
closeWithLine_15 = PolyCurve.CloseWithLine(polyCurve=byJoinedCurves_15)
dropItems_9 = List.DropItems(list=curves_8, amount=code_block_12)
byJoinedCurves_16 = PolyCurve.ByJoinedCurves(curves=dropItems_9)
closeWithLine_16 = PolyCurve.CloseWithLine(polyCurve=byJoinedCurves_16)
list_create_11 = List.Create(item0=closeWithLine_15, item1=closeWithLine_16)
byLoft_10 = Solid.ByLoft(crossSections=list_create_11)
list_create_12 = List.Create(item0=byLoft, item1=byLoft_2, item2=byLoft_3, item3=byLoft_4, item4=byLoft_5, item5=byLoft_6, item6=byLoft_7, item7=byLoft_8, item8=byLoft_9, item9=byLoft_10)
code_block_13 = CodeBlock { 1; }
flatten = List.Flatten(list=list_create_12, amount=code_block_13)
code_block_14 = CodeBlock { 1..10; }
getItemAtIndex_17 = List.GetItemAtIndex(list=flatten, index=code_block_14)
file_path_2 = Filename("C:\ProgramData\Autodesk\RVT 2023\Family Templates\Chinese\公制常规模型.rft")
string_from_object = FromObject(object=code_block_14)
categories = Categories("OST_GenericModel")
code_block_15 = CodeBlock { "混凝土"; }
ꟿ_familyinstance_bygeometry = Custom[ꟿ FamilyInstance.ByGeometry](geometry=getItemAtIndex_17, familyTemplatePath=file_path_2, familyName=string_from_object, category=categories, materialName=code_block_15)  # package spring nodes; You must provide a valid family template path that will be used for all input geometry objects. The project units(and not the templates) will be used to determine the size of the output geometry. The provided category will be used only if the family template supports it. If not, the default template category will be used instead. Likewise, the family material(provided as a string) will be set only if a material with that name exists in the template. If not, the default material will be used instead ("By Category"). For void cuts, the material settings will be ignored. The Subcategory name is an optional input. If you'd like to skip assigning a Subcategory to any new instance, simply use null. The node expects a unique family name for each geometry object. The rest of the input lists will be processed as if the node lacing is set to longest.
exportToSAT = ExportWithUnits(SelectedExportedUnitsSource=[0, 1, 2, 3, 5, 4], SelectedExportedUnit=0)  # unwired: geometry
